# Grasshopper definition hops_sample_for_host_create_sphere.gh (Grasshopper 1.0.7)

base = GetInteger(Slider(6, range=0..10), AtLeast=1, AtMost=1, Maximum=2147483647, Minimum=-2147483648, TreeAccess=False)
radius = GetInteger(Slider(5, range=0..10), AtLeast=1, AtMost=1, Maximum=2147483647, Minimum=-2147483648, TreeAccess=False)
pt = ConstructPoint(XCoordinate=0, YCoordinate=base, ZCoordinate=0)
sph = Sphere(Base=pt, Radius=radius)
context_bake = ContextBake(Geometry=sph)
